# Grasshopper definition 01 Five-Points.gh (Grasshopper 1.0.4)

frequency = Slider(80.757, range=75..100)
frequency_2 = Slider(100, range=75..100)
amp = Slider(20.947, range=-100..100)
amp_2 = Slider(-20.558, range=-100..100)
detail = Slider(9.614, range=5..30)
xz_rotate = Slider(0.664, range=-2..2)
distance = Slider(400, range=100..400)
yz_rotate = Slider(0.917, range=-3..3)
pt = Point(<point referenced from the Rhino model>)
pt_2 = Point(pt)
X = UnitX(Factor=frequency)
Z = UnitZ(Factor=distance)
X_2 = UnitX(Factor=frequency_2)
number = Number(-1)
number_2 = Number(-1)
move = Move(Geometry=pt, Motion=X)  # -> Geometry, Transform
move_2 = Move(Geometry=pt_2, Motion=Z)  # -> Geometry, Transform
move_3 = Move(Geometry=move_2.Geometry, Motion=X_2)  # -> Geometry, Transform
multiplication = Multiplication(A=amp_2, B=number)
multiplication_2 = Multiplication(A=amp, B=number_2)
move_4 = Move(Geometry=move.Geometry, Motion=X)  # -> Geometry, Transform
move_5 = Move(Geometry=move_3.Geometry, Motion=X_2)  # -> Geometry, Transform
Y = UnitY(Factor=amp_2)
Y_2 = UnitY(Factor=multiplication)
move_6 = Move(Geometry=move_4.Geometry, Motion=X)  # -> Geometry, Transform
Y_3 = UnitY(Factor=amp)
Y_4 = UnitY(Factor=multiplication_2)
move_7 = Move(Geometry=move_5.Geometry, Motion=X_2)  # -> Geometry, Transform
move_8 = Move(Geometry=move_6.Geometry, Motion=X)  # -> Geometry, Transform
move_9 = Move(Geometry=move_7.Geometry, Motion=X_2)  # -> Geometry, Transform
move_10 = Move(Geometry=move.Geometry, Motion=Y_2)  # -> Geometry, Transform
move_11 = Move(Geometry=pt, Motion=Y)  # -> Geometry, Transform
move_12 = Move(Geometry=move_4.Geometry, Motion=Y)  # -> Geometry, Transform
move_13 = Move(Geometry=move_8.Geometry, Motion=Y)  # -> Geometry, Transform
move_14 = Move(Geometry=move_6.Geometry, Motion=Y_2)  # -> Geometry, Transform
move_15 = Move(Geometry=move_3.Geometry, Motion=Y_4)  # -> Geometry, Transform
move_16 = Move(Geometry=move_2.Geometry, Motion=Y_3)  # -> Geometry, Transform
move_17 = Move(Geometry=move_5.Geometry, Motion=Y_3)  # -> Geometry, Transform
move_18 = Move(Geometry=move_9.Geometry, Motion=Y_3)  # -> Geometry, Transform
move_19 = Move(Geometry=move_7.Geometry, Motion=Y_4)  # -> Geometry, Transform
intcrv_t = InterpolateT(
    Vertices=[move_11.Geometry, move_10.Geometry, move_12.Geometry, move_14.Geometry, move_13.Geometry],
    Degree=3,
    TangentStart=Vector(0, 0, 0),
    TangentEnd=Vector(0, 0, 0),
    KnotStyle=1)  # -> Curve, Length, Domain
intcrv_t_2 = InterpolateT(
    Vertices=[move_16.Geometry, move_15.Geometry, move_17.Geometry, move_19.Geometry, move_18.Geometry],
    Degree=3,
    TangentStart=Vector(0, 0, 0),
    TangentEnd=Vector(0, 0, 0),
    KnotStyle=1)  # -> Curve, Length, Domain
yz = YZPlane(Origin=Point(0, 0, 0))
loft = Loft(
    Curves=[intcrv_t.Curve, intcrv_t_2.Curve],
    Options={Adjust=False, Closed=False, LoftEnds=0, LoftSimp=0, LoftType=0, Rebuild=10, Refit=0.01})
rotate = Rotate(Geometry=loft, Angle=yz_rotate, Plane=yz)  # -> Geometry, Transform
xz = XZPlane(Origin=Point(0, 0, 0))
mesh_uv = MeshSurface(Surface=rotate.Geometry, UCount=detail, VCount=detail, Overhang=True, Equalize=False)
rotate_2 = Rotate(Geometry=mesh_uv, Angle=xz_rotate, Plane=xz)  # -> Geometry, Transform
xy = XYPlane(Origin=Point(0, 0, 0))
project = Project(Geometry=rotate_2.Geometry, Plane=xy)  # -> Geometry, Transform
geo = Geometry(project.Geometry)
bake_me = Geometry(geo)
